# Grasshopper definition CurveComponent.gh (Grasshopper 0.9.76)

mesh = Mesh(<mesh referenced from the Rhino model>)
component = Curve([<curve referenced from the Rhino model> x2])
demesh = DeconstructMesh(Mesh=mesh)  # -> Vertices, Faces, Colours, Normals
deface = DeconstructFace(Face=demesh.Faces)  # -> CornerA, CornerB, CornerC, CornerD
bbox = BoundingBox(Content=component, Plane=PlaneXY(0, 0, 0), UnionBox=True)  # -> Box, Box_2
item = ListItem(List=demesh.Normals, Index=deface.CornerD, Wrap=True)
item_2 = ListItem(List=demesh.Normals, Index=deface.CornerC, Wrap=True)
item_3 = ListItem(List=demesh.Normals, Index=deface.CornerB, Wrap=True)
item_4 = ListItem(List=demesh.Normals, Index=deface.CornerA, Wrap=True)
item_5 = ListItem(List=demesh.Vertices, Index=deface.CornerD, Wrap=True)
item_6 = ListItem(List=demesh.Vertices, Index=deface.CornerC, Wrap=True)
item_7 = ListItem(List=demesh.Vertices, Index=deface.CornerB, Wrap=True)
item_8 = ListItem(List=demesh.Vertices, Index=deface.CornerA, Wrap=True)
number_slider = Slider(4.365, range=0..20)
multiplication = Multiplication(A=item_3, B=number_slider)
multiplication_2 = Multiplication(A=item_2, B=number_slider)
multiplication_3 = Multiplication(A=item, B=number_slider)
multiplication_4 = Multiplication(A=item_4, B=number_slider)
addition = Addition(A=item_8, B=multiplication_4)
addition_2 = Addition(A=item_7, B=multiplication)
addition_3 = Addition(A=item_5, B=multiplication_3)
addition_4 = Addition(A=item_6, B=multiplication_2)
tbox = TwistedBox(
    CornerA=item_8,
    CornerB=item_7,
    CornerC=item_6,
    CornerD=item_5,
    CornerE=addition,
    CornerF=addition_2,
    CornerG=addition_4,
    CornerH=addition_3)
morph = BoxMorph(Geometry=graft(component), Reference=bbox.Box, Target=tbox)
